# Grasshopper definition hops_creation.gh (Grasshopper 1.0.7)

get_closed_curve = GetGeometry(AtLeast=1, AtMost=1, DeleteInput=False, Filter=1073741828)
get_integer = GetInteger(AtLeast=1, AtMost=1, Maximum=2147483647, Minimum=-2147483648)
crv = Curve(get_closed_curve)
divide = DivideCurve(Curve=crv, Count=get_integer, Kinks=False)  # -> Points, Tangents, Parameters
curvature = Curvature(Curve=crv, Parameter=divide.Parameters)  # -> P, K, C
darc = DeconstructArc(Arc=curvature.C)  # -> BasePlane, Radius, Angle
ln = Line(StartPoint=divide.Points, EndPoint=darc.BasePlane)
pt = Point(darc.BasePlane)
pline = PolyLine(Vertices=pt, Closed=True)
context_bake = ContextBake(Geometry=pline)
context_bake_2 = ContextBake(Geometry=ln)
