# Grasshopper definition hops_exam.gh (Grasshopper 1.0.7)
# plug-ins: Hops

number_slider = Slider(200, range=0..1000)
crv = Curve(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)
locally = Hops(
    GetClosedCurve=crv,
    GetInteger=number_slider,
    CacheResultsInMemory=True,
    CacheSolveResults=True,
    RemoteDefinitionLocation="Z:\Desktop\MPDA\AT\at_apy\mpda22-session01\03\hops_creation.gh",
    RemoteSolveVersion=(0, 1, 0),
    ShowInput_Enabled=False,
    ShowInput_Path=False,
    SynchronousSolve=True)  # -> Line, Polyline
# Note: mac version of Hops only works for externe python server
reomtely = Hops(
    GetClosedCurve=crv,
    GetInteger=number_slider,
    CacheResultsInMemory=True,
    CacheSolveResults=True,
    RemoteDefinitionLocation="https://github.com/zenorm/mpda22-session01/blob/main/03/hops_creation.gh?raw=true",
    RemoteSolveVersion=(0, 1, 0),
    ShowInput_Enabled=False,
    ShowInput_Path=False,
    SynchronousSolve=True)  # -> Line, Polyline
crv_2 = Curve(locally.Polyline)
line = Line(locally.Line)
